# Grasshopper definition velosharing.gh (Grasshopper 0.9.76)
# plug-ins: HDTReference

path = FilePath("D:\DUE\1 семестр\Urban Informatics\velo\Coordinates.csv")
path_2 = FilePath("D:\DUE\1 семестр\Urban Informatics\velo\stats_ amount_trips.csv")
path_3 = FilePath("D:\DUE\1 семестр\Urban Informatics\velo\from_station_to_station.csv")
panel = Panel(path_2)
panel_2 = Panel(path_3)
panel_3 = Panel(path)
file = ReadFile(File=path_2, PerLineParse=True)
file_2 = ReadFile(File=panel_2, PerLineParse=True)
file_3 = ReadFile(File=panel_3, PerLineParse=True)
panel_4 = Panel(file)
panel_5 = Panel(file_2)
pipeline = GeometryPipeline(
    GroupByLayer=False,
    GroupByType=False,
    IncludeHidden=True,
    IncludeLocked=True,
    LayerFilter="Graph",
    NameFilter="*",
    TypeFilter=1)
panel_6 = Panel(file_3)
pt = Point(pipeline)
plfit = PlaneFit(Points=pt)  # -> Plane, Deviation
recgrid = Rectangular(
    Plane=plfit.Plane,
    SizeX=1,
    SizeY=Slider(1, range=0..1),
    ExtentX=Slider(122, range=0..366),
    ExtentY=Slider(50, range=0..100))  # -> Cells, Points
split = TextSplit(Text=panel_6, Separators=",")
split_2 = TextSplit(Text=panel_5, Separators=",")
split_3 = TextSplit(Text=panel_4, Separators=",")
item = ListItem(List=split_2, Index="4", Wrap=False)  # -> flatten(Element)
item_2 = ListItem(List=split_2, Index="3", Wrap=False)  # -> flatten(Element)
item_3 = ListItem(List=split_2, Index="1", Wrap=False)  # -> flatten(Element)
item_4 = ListItem(List=split_3, Index="1", Wrap=True)  # -> flatten(Item)
item_5 = ListItem(List=split, Index="3", Wrap=True)  # -> flatten(Item)
item_6 = ListItem(List=split, Index="2", Wrap=True)  # -> flatten(Item)
item_7 = ListItem(List=split, Index="1", Wrap=True)  # -> flatten(Item)
all_except_1st = AllExcept1st(L=item)
all_except_1st_2 = AllExcept1st(L=item_2)
all_except_1st_3 = AllExcept1st(L=item_4)
all_except_1st_4 = AllExcept1st(L=item_6)
all_except_1st_5 = AllExcept1st(L=item_3)
all_except_1st_6 = AllExcept1st(L=item_5)
all_except_1st_7 = AllExcept1st(L=item_7)
subset = SubList(List=item, Domain=all_except_1st, Cycle=False)  # -> List, Index
subset_2 = SubList(List=item_2, Domain=all_except_1st_2, Cycle=False)  # -> List, Index
subset_3 = SubList(List=item_4, Domain=all_except_1st_3, Cycle=False)  # -> List, Index
subset_4 = SubList(List=item_5, Domain=all_except_1st_6, Cycle=False)  # -> flatten(List), Index
subset_5 = SubList(List=item_7, Domain=all_except_1st_7, Cycle=False)  # -> List, Index
subset_6 = SubList(List=item_6, Domain=all_except_1st_4, Cycle=False)  # -> flatten(List), Index
subset_7 = SubList(List=item_3, Domain=all_except_1st_5, Cycle=False)  # -> List, Index
date = ConstructDate(
    Year=Slider(2014, range=0..10000),
    Month=Slider(6, range=0..12),
    Day=Slider(27, range=0..31),
    Hour=Slider(0, range=0..24),
    Minute=Slider(0, range=0..60),
    Second=Slider(0, range=0..60))
date_2 = ConstructDate(
    Year=Slider(2014, range=0..10000),
    Month=Slider(10, range=0..12),
    Day=Slider(31, range=0..31),
    Hour=Slider(0, range=0..23),
    Minute=Slider(0, range=0..59),
    Second=Slider(0, range=0..59))
panel_7 = Panel(subset_3.List)
номера_станций = Panel(subset_5.List)
нст2 = Panel(subset_2.List)
нст1 = Panel(subset_7.List)
cluster = Cluster(V_2=subset_4.List, V=subset_6.List)  # -> R, R_2
multiplication = Multiplication(A=panel_7, B=Slider(100, range=0..100))
rdate = DateRange(TimeA=date, TimeB=date_2, Count=Slider(127, range=0..366))
pt_2 = ConstructPoint(XCoordinate=cluster.R, YCoordinate=cluster.R_2, ZCoordinate=0)
panel_8 = Panel(rdate)
division = Division(A=multiplication, B=Slider(1439.9, range=0..100000))
panel_9 = Panel(division)
swatch = ColourSwatch(SwatchColor=RGB(9, 169, 222))
sph = Sphere(Base=pt_2, Radius=division)
cir = Circle(Plane=pt_2, Radius=division)
preview = CustomPreview(Geometry=sph, Shader=swatch)
preview_2 = CustomPreview(Geometry=cir, Shader=swatch)
crossref = CrossReference(ListA=номера_станций, ListB=номера_станций, CrossMode=1)  # -> ListA, ListB
concat = Concatenate(A=нст1, B="-->", C=нст2)
split_4 = TextSplit(Text=panel_8, Separators=",")
concat_2 = Concatenate(A=crossref.ListA, B="-->", C=crossref.ListB)
станции_от_до_данные = Panel(concat)
item_8 = ListItem(List=split_4, Index="1", Wrap=True)  # -> flatten(Item)
число_прокатов = Panel(subset.List)
pt_3 = Point(pt_2)
pt_4 = Point(pt_2)
все_возможные_пересечения = Panel(concat_2)
panel_10 = Panel(item_8)
crossref_2 = CrossReference(ListA=pt_3, ListB=pt_4, CrossMode=1)  # -> ListA, ListB
ln = Line(StartPoint=crossref_2.ListA, EndPoint=crossref_2.ListB)
keysearch = KeyValueSearch(Keys=станции_от_до_данные, Values=число_прокатов, Search=все_возможные_пересечения)
division_2 = Division(A=keysearch, B=Slider(22, range=1..1000))
sort = SortList(Keys=keysearch)  # -> Keys, ValuesA

# ---- group: Скорость
расстояние_по_карте = GeometryPipeline(
    GroupByLayer=False,
    GroupByType=False,
    IncludeHidden=True,
    IncludeLocked=True,
    LayerFilter="*",
    NameFilter="*",
    TypeFilter=4)
расстояние_реальное_в_км = Panel("19.001")
dist = Distance(PointA=crossref_2.ListA, PointB=crossref_2.ListB)
remap = RemapNumbers(Value=dist, Source=расстояние_по_карте, Target=расстояние_реальное_в_км)  # -> Mapped, Clipped
км_расстояние = Panel(remap.Mapped)

# ----
lng = ListLength(List=sort.Keys)
panel_11 = Panel("""750-1000
200 - 750
150-200 - 8
100-150 - 26
50-100 - 75
0-50< - 713""")
subtraction = Subtraction(A=lng, B="1")
item_9 = ListItem(List=sort.Keys, Index=0, Wrap=True)
item_10 = ListItem(List=subtraction, Index=0, Wrap=True)
# разбиение по цветам отображается не совсем правильно. Если убрать толщину линий, то красным подсвечиваются линии без проехавших велосипедистов. А если добавить толщину линий, то везде где значение велосипедистов меньше единицы цвет линии становится красным
# Подумать над разбиением линий-поездок по слоям. Для отключения незначительных перемещений
gradient = Gradient(
    LowerLimit=item_9,
    UpperLimit=item_10,
    Parameter=keysearch,
    stops=[0: RGBA(255, 255, 255, 0), 0: RGB(255, 255, 255), 0.05: RGB(0, 255, 0), 0.1: RGB(255, 255, 0), 0.15: RGB(255, 128, 0), 0.2: RGB(255, 0, 0), 0.75: RGB(128, 0, 128), 1: RGB(0, 0, 128), 1: RGB(255, 128, 0)])
# цвета подобраны в соответствии с количеством проехавших велосипедистов. Расположение цветов на градиенте выбраны  на основе графа построенного ниже
preview_3 = CustomPreview(Geometry=ln, Shader=gradient)  # disabled
previewlw = CustomPreviewLineweights(Geometry=ln, Shader=gradient, Thickness=division_2)

path_4 = FilePath("D:\DUE\1 семестр\Urban Informatics\velo\weather.csv")
panel_12 = Panel(path_4)
file_4 = ReadFile(File=panel_12, PerLineParse=True)
split_5 = TextSplit(Text=file_4, Separators=",")
item_11 = ListItem(List=split_5, Index=0, Wrap=True)  # -> flatten(Item)
all_except_1st_8 = AllExcept1st(L=item_11)
subset_8 = SubList(List=item_11, Domain=all_except_1st_8, Wrap=True)  # -> List, Index

item_12 = ListItem(List=split_5, Index="1", Wrap=True)  # -> flatten(Item)
item_13 = ListItem(List=split_5, Index="2", Wrap=True)  # -> flatten(Item)
item_14 = ListItem(List=split_5, Index="3", Wrap=True)  # -> flatten(Item)
all_except_1st_9 = AllExcept1st(L=item_12)
all_except_1st_10 = AllExcept1st(L=item_13)
all_except_1st_11 = AllExcept1st(L=item_14)
subset_9 = SubList(List=item_12, Domain=all_except_1st_9, Wrap=True)  # -> List, Index
subset_10 = SubList(List=item_13, Domain=all_except_1st_10, Wrap=True)  # -> List, Index
subset_11 = SubList(List=item_14, Domain=all_except_1st_11, Wrap=True)  # -> List, Index
rev = ReverseList(List=subset_8.List)
rev_2 = ReverseList(List=subset_9.List)
rev_3 = ReverseList(List=subset_10.List)
rev_4 = ReverseList(List=subset_11.List)
lng_2 = ListLength(List=rev_2)
скорость_ветра_м_с = Panel(rev_3)

осадки = Panel(rev_4)
даты_и_время = Panel(rev)
температура = Panel(rev_2)

num = Number(температура)
series = Series(Start=Slider(-500, range=-500..10), Step=Slider(0.125, range=0..1), Count=lng_2)
pt_5 = ConstructPoint(XCoordinate=series, YCoordinate=num, ZCoordinate=0)
pt_6 = Point(pt_5)
pline = PolyLine(Vertices=pt_6, Closed=False)
preview_4 = CustomPreview(Geometry=pline, Shader=ColourSwatch(SwatchColor=RGB(232, 21, 31)))

# ---- group: скорость
# 1. Как убрать пустые линии. Без поездок.
# 2. Как измерить расстояние между станциями
# To check slot of "Key/value research", - all output data are similar. It's not right. Parameter of longiness is Ok. But parameter of Distance after "Key/value research" not OK. I have some troubles with "k/v research" - he doesn't work correctly
# Скорость=расстояние/время.
# Время=продолжительность поездки. Расстояние = расстоянию между точками проката
path_5 = FilePath("D:\DUE\1 семестр\Urban Informatics\velo\trips\01_09-07.csv")
panel_13 = Panel(path_5)
file_5 = ReadFile(File=panel_13, PerLineParse=True)
panel_14 = Panel(file_5)
split_6 = TextSplit(Text=panel_14, Separators=",")
item_15 = ListItem(List=split_6, Index="9", Wrap=True)  # -> flatten(Item)
item_16 = ListItem(List=split_6, Index="3", Wrap=True)  # -> flatten(Item)
item_17 = ListItem(List=split_6, Index="7", Wrap=True)  # -> flatten(Item)
all_except_1st_12 = AllExcept1st(L=item_16)
all_except_1st_13 = AllExcept1st(L=item_17)
subset_12 = SubList(List=item_17, Domain=all_except_1st_13, Wrap=True)  # -> List, Index
subset_13 = SubList(List=item_16, Domain=all_except_1st_12, Wrap=True)  # -> List, Index
concat_3 = Concatenate(FragmentA=subset_12.List, FragmentB="-->", FragmentC=subset_13.List)
panel_15 = Panel(все_возможные_пересечения)
panel_16 = Panel(remap.Mapped)
item_18 = ListItem(List=concat_3, Index=0, Wrap=True)
subset_14 = SubList(List=item_18, Domain="0:840", Wrap=True)  # -> List, Index
keysearch_2 = KeyValueSearch(Keys=panel_15, Values=panel_16, Search=subset_14.List)

# ----
all_except_1st_14 = AllExcept1st(L=item_15)

# ---- group: скорость (continued)
subset_15 = SubList(List=item_15, Domain=all_except_1st_14, Wrap=True)  # -> List, Index
ddate = DeconstructDate(Date=subset_15.List)  # -> Year, Month, Day, Hour, Minute, Second
division_3 = Division(A=ddate.Minute, B="60")
division_4 = Division(A=ddate.Second, B="3600")
addition = Addition(A=division_3, B=division_4)
addition_2 = Addition(A=ddate.Hour, B=addition)
division_5 = Division(A=keysearch_2, B=addition_2)
panel_17 = Panel(division_5)
bar_graph = BarGraph(division_5, BarColor=RGB(255, 0, 90))
sort_2 = SortList(Keys=panel_17)  # -> Keys, ValuesA

# ----
# Дни недели. Выходные. праздники.Осадки
panel_18 = Panel("2")
item_19 = ListItem(List=split_6, Index=panel_18, Wrap=True)  # -> flatten(Item)
all_except_1st_15 = AllExcept1st(L=item_19)
subset_16 = SubList(List=item_19, Domain=all_except_1st_15, Wrap=True)  # -> List, Index
rev_5 = ReverseList(List=subset_16.List)
cset = CreateSet(List=rev_5)  # -> Set, Map
mindex = MemberIndex(Set=rev_5, Member=cset.Set)  # -> Index, Count
lng_3 = ListLength(List=mindex.Count)
series_2 = Series(Start=Slider(-500, range=-500..10), Step=Slider(1, range=0..10), Count=lng_3)
# Нужно подумать как на график нанести даты. И чтобы данные совпадали с датами. Переделать на прямоугольники вид графика
swatch_2 = ColourSwatch(SwatchColor=RGB(105, 207, 255))

division_6 = Division(A=mindex.Count, B=Slider(14, range=0..50))

pt_7 = ConstructPoint(XCoordinate=series_2, YCoordinate=division_6, ZCoordinate=0)
pt_8 = Point(pt_7)
pline_2 = PolyLine(Vertices=pt_8, Closed=False)
preview_5 = CustomPreview(Geometry=pline_2, Shader=swatch_2)

# ==== cluster Cluster
pipeline = GeometryPipeline(
    GroupByLayer=False,
    GroupByType=False,
    IncludeHidden=True,
    IncludeLocked=True,
    LayerFilter="Default",
    NameFilter="*",
    TypeFilter=1)
pt = Point(pipeline)
pdecon = Deconstruct(Point=pt)  # -> XComponent, YComponent, ZComponent
bnd = Bounds(Numbers=pdecon.XComponent)
bnd_2 = Bounds(Numbers=pdecon.YComponent)
V = ClusterInput()
V_2 = ClusterInput()

panel = Panel("""60.0093,30.177
59.8386,30.4888,""")
split = TextSplit(Text=panel, Separators=",")

item = ListItem(List=split, Index="0", Wrap=True)  # -> flatten(Item)
item_2 = ListItem(List=split, Index="1", Wrap=True)  # -> flatten(Item)

bnd_3 = Bounds(Numbers=item)
bnd_4 = Bounds(Numbers=item_2)

remap = RemapNumbers(Value=V_2, Source=bnd_4, Target=bnd)  # -> Mapped, Clipped
remap_2 = RemapNumbers(Value=V, Source=bnd_3, Target=bnd_2)  # -> Mapped, Clipped
R = ClusterOutput(remap.Mapped)
R_2 = ClusterOutput(remap_2.Mapped)

# ==== cluster AllExcept1st
L = ClusterInput()
lng = ListLength(List=L)
subtraction = Subtraction(A=lng, B="1")
dom = ConstructDomain(DomainStart="1", DomainEnd=subtraction)
I = ClusterOutput(dom)
