# Grasshopper definition velosharing2.gh (Grasshopper 0.9.76)
# plug-ins: HDTReference

# ---- group: скорость
# Скорость=расстояние/время.
# Время=продолжительность поездки. Расстояние = расстоянию между точками проката
path = FilePath("D:\DUE\1 семестр\Urban Informatics\velo\trips\All-trips.csv")
panel = Panel(path)
file = ReadFile(File=panel, PerLineParse=True)
panel_2 = Panel(file)
split = TextSplit(Text=panel_2, Separators=",")

# ----
path_2 = FilePath("D:\DUE\1 семестр\Urban Informatics\velo\trips\Dates.csv")
file_2 = ReadFile(File=path_2, PerLineParse=True)
cset = CreateSet(List=file_2)  # -> Set, Map
date = ConstructDate(
    Year=Slider(2014, range=0..10000),
    Month=Slider(6, range=0..12),
    Day=Slider(27, range=0..31),
    Hour=Slider(0, range=0..24),
    Minute=Slider(0, range=0..60),
    Second=Slider(0, range=0..60))
date_2 = ConstructDate(
    Year=Slider(2014, range=0..10000),
    Month=Slider(11, range=0..12),
    Day=Slider(4, range=0..31),
    Hour=Slider(0, range=0..23),
    Minute=Slider(0, range=0..59),
    Second=Slider(0, range=0..59))
rdate = DateRange(TimeA=date, TimeB=date_2, Count=Slider(131, range=0..366))
panel_3 = Panel(rdate)
split_2 = TextSplit(Text=panel_3, Separators=",")
item = ListItem(List=split_2, Index="1", Wrap=True)  # -> flatten(Item)
panel_4 = Panel(item)
прокат = BooleanToggle(False)

# ---- group: Температура
path_3 = FilePath("D:\DUE\1 семестр\Urban Informatics\velo\Weather.csv")
panel_5 = Panel(path_3)
file_3 = ReadFile(File=panel_5, PerLineParse=True)
split_3 = TextSplit(Text=file_3, Separators=",")
pipeline = GeometryPipeline(
    GroupByLayer=False,
    GroupByType=False,
    IncludeHidden=True,
    IncludeLocked=True,
    LayerFilter="Graph",
    NameFilter="*",
    TypeFilter=1)
item_2 = ListItem(List=split_3, Index=0, Wrap=True)  # -> flatten(Item)
item_3 = ListItem(List=split_3, Index="1", Wrap=True)  # -> flatten(Item)
item_4 = ListItem(List=split_3, Index="2", Wrap=True)  # -> flatten(Item)
item_5 = ListItem(List=split_3, Index="3", Wrap=True)  # -> flatten(Item)
pt = Point(pipeline)
all_except_1st = AllExcept1st(L=item_2)
all_except_1st_2 = AllExcept1st(L=item_3)
all_except_1st_3 = AllExcept1st(L=item_4)
all_except_1st_4 = AllExcept1st(L=item_5)
subset = SubList(List=item_2, Domain=all_except_1st, Wrap=True)  # -> List, Index
subset_2 = SubList(List=item_3, Domain=all_except_1st_2, Wrap=True)  # -> List, Index
subset_3 = SubList(List=item_4, Domain=all_except_1st_3, Wrap=True)  # -> List, Index
subset_4 = SubList(List=item_5, Domain=all_except_1st_4, Wrap=True)  # -> List, Index
plfit = PlaneFit(Points=pt)  # -> Plane, Deviation
rev = ReverseList(List=subset.List)
rev_2 = ReverseList(List=subset_2.List)
rev_3 = ReverseList(List=subset_3.List)
rev_4 = ReverseList(List=subset_4.List)
lng = ListLength(List=rev_2)
recgrid = Rectangular(
    Plane=plfit.Plane,
    SizeX=1,
    SizeY=Slider(1, range=0..1),
    ExtentX=Slider(129, range=0..366),
    ExtentY=Slider(50, range=0..100))  # -> Cells, Points
скорость_ветра_м_с = Panel(rev_3)
осадки = Panel(rev_4)
даты_и_время = Panel(rev)
температура = Panel(rev_2)
num = Number(скорость_ветра_м_с)
num_2 = Number(температура)
series = Series(Start=Slider(0, range=-500..10), Step=Slider(0.125, range=0..1), Count=lng)
pt_2 = ConstructPoint(XCoordinate=series, YCoordinate=num_2, ZCoordinate=0)
pt_3 = Point(pt_2)
swatch = ColourSwatch(SwatchColor=RGB(232, 172, 21))
pline = PolyLine(Vertices=pt_3, Closed=False)
swatch_2 = ColourSwatch(SwatchColor=RGB(10, 55, 252))
createatts = CreateAttributes(Color=swatch_2)
createatts_2 = CreateAttributes(Color=swatch)
preview = CustomPreview(Geometry=pline, Shader=swatch)
температура_2 = BooleanToggle(False)
bake = BakeGeometry(Bake=температура_2, Geometry=pline, Attributes=createatts_2)
ветер = BooleanToggle(False)

# ----
lng_2 = ListLength(List=rev_3)
data = Data(температура)

# ---- group: Температура (continued)
series_2 = Series(Start=Slider(0, range=-500..10), Step=Slider(0.125, range=0..1), Count=lng_2)
pt_4 = ConstructPoint(XCoordinate=series_2, YCoordinate=num, ZCoordinate=0)
pt_5 = Point(pt_4)
pline_2 = PolyLine(Vertices=pt_5, Closed=False)
preview_2 = CustomPreview(Geometry=pline_2, Shader=swatch_2)
bake_2 = BakeGeometry(Bake=ветер, Geometry=pline_2, Attributes=createatts)

# ----
# Дни недели. Выходные. праздники.Осадки
panel_6 = Panel("2")
item_6 = ListItem(List=split, Index=panel_6, Wrap=True)  # -> flatten(Item)
all_except_1st_5 = AllExcept1st(L=item_6)
subset_5 = SubList(List=item_6, Domain=all_except_1st_5, Wrap=True)  # -> List, Index
all_except_1st_6 = AllExcept1st(L=subset_5.Index)
subset_6 = SubList(List=subset_5.List, Domain=all_except_1st_6, Wrap=True)  # -> List, Index
rev_5 = ReverseList(List=subset_6.List)
cset_2 = CreateSet(List=rev_5)  # -> Set, Map
mindex = MemberIndex(Set=rev_5, Member=cset_2.Set)  # -> Index, Count
swatch_3 = ColourSwatch(SwatchColor=RGB(105, 207, 255))

keysearch = KeyValueSearch(Keys=cset_2.Set, Values=mindex.Count, Search=cset.Set)
panel_7 = Panel(keysearch)
nullrep = ReplaceNulls(Items=panel_7, Replacements=Slider(0, range=0..100))  # -> Items, Count
panel_8 = Panel(nullrep.Items)
createatts_3 = CreateAttributes(Color=swatch_3)

lng_3 = ListLength(List=panel_7)
series_3 = Series(Start=Slider(0, range=-500..10), Step=Slider(1, range=0..10), Count=lng_3)

division = Division(A=panel_8, B=Slider(10, range=0..50))

pt_6 = ConstructPoint(XCoordinate=series_3, YCoordinate=division, ZCoordinate=0)
# Нужно подумать как на график нанести даты. И чтобы данные совпадали с датами. Переделать на прямоугольники вид графика
pt_7 = Point(pt_6)
pline_3 = PolyLine(Vertices=pt_7, Closed=False)
preview_3 = CustomPreview(Geometry=pline_3, Shader=swatch_3)

pdecon = Deconstruct(Point=pt_7)  # -> XComponent, YComponent, ZComponent
subtraction = Subtraction(A=pdecon.XComponent, B=Slider(1, range=0..1))
pt_8 = ConstructPoint(XCoordinate=subtraction, YCoordinate=Slider(0, range=0..100), ZCoordinate=pdecon.ZComponent)
pt_9 = Point(pt_8)

rec_2pt = Rectangle2Pt(Plane=PlaneXY(0, 0, 0), PointA=pt_7, PointB=pt_9, Radius=0)  # -> Rectangle, Length

preview_4 = CustomPreview(Geometry=rec_2pt.Rectangle, Shader=swatch_3)
bake_3 = BakeGeometry(Bake=прокат, Geometry=rec_2pt.Rectangle, Attributes=createatts_3)

# ==== cluster AllExcept1st
L = ClusterInput()
lng = ListLength(List=L)
subtraction = Subtraction(A=lng, B="1")
dom = ConstructDomain(DomainStart="1", DomainEnd=subtraction)
I = ClusterOutput(dom)
